# Dynamo graph MarkBySpline.dyn (Dynamo 2.13.1.3887)

# group: Starting Inputs
parking_stall_selection = DSModelElementsByCategorySelection("OST_Parking")  # 102 picked in the model; graph input
spline = DSModelElementSelection()  # 1 picked in the model; graph input
starting_number = IntegerSlider(1, range=0..1000 step 1)  # graph input

# group: Parking Tags
current = Document.Current()
activeView = Document.ActiveView(document=current)
code_block = CodeBlock { true; false; "Left"; "Bottom"; }
code_block_2 = CodeBlock { 3; 6; }
byCoordinates = Vector.ByCoordinates(x=code_block_2.out0, y=code_block_2.out1)
byElement = Tag.ByElement(view=activeView, element=parking_stall_selection, horizontal=code_block.out0, addLeader=code_block.out1, horizontalAlignment=code_block.out2, verticalAlignment=code_block.out3, offset=byCoordinates)

# group: Reference Geometry
geometry = Element.Geometry(element=spline)
# note: Ensuring that the parking stall location points and the spline are on the same plane (XY)
XY = Plane.XY()
pullOntoPlane = Curve.PullOntoPlane(curve=geometry, plane=XY)
getLocation = Element.GetLocation(element=parking_stall_selection)
code_block_3 = CodeBlock(loc=getLocation) { Point.X(loc); Point.Y(loc); }
byCoordinates_2 = Point.ByCoordinates(x=code_block_3.out0, y=code_block_3.out1)

# group: Creating a range of numbers to update the mark values of the selected parking stalls
closestPointTo = Geometry.ClosestPointTo(geometry=pullOntoPlane, other=byCoordinates_2, lacing=Longest)
parameterAtPoint = Curve.ParameterAtPoint(curve=pullOntoPlane, point=closestPointTo, lacing=Longest)
sortByKey = List.SortByKey(list=parking_stall_selection, keys=parameterAtPoint)
count = List.Count(list=sortByKey.sortedList)
code_block_4 = CodeBlock(n=starting_number, c=count) { n..n+(c-1)..1; }
string_from_object = FromObject(object=code_block_4)
code_block_5 = CodeBlock { "."; }
split = String.Split(string=string_from_object, separator0=code_block_5)
code_block_6 = CodeBlock { 0; }
getItemAtIndex = List.GetItemAtIndex(list=split@L2, index=code_block_6)

# group: Trailing Zeroes for Stall Numbers
length = String.Length(string=getItemAtIndex)
code_block_7 = CodeBlock { 1; }
gt = length > code_block_7
prefix = StringInput("0")
add = prefix + getItemAtIndex
prefix_2 = StringInput("00")
add_2 = prefix_2 + getItemAtIndex
if_ = RefactoredIf(test=gt, true=add, false=add_2, lacing=Shortest)
length_2 = String.Length(string=if_)
code_block_8 = CodeBlock { 4; }
ge = length_2 >= code_block_8
code_block_9 = CodeBlock { 0; 1; }
remove = String.Remove(string=if_, startIndex=code_block_9.out0, count=code_block_9.out1)
if_2 = RefactoredIf(test=ge, true=remove, false=if_, lacing=Shortest)

# group: Updating Marks
parameter_to_set = StringInput("Mark")
setParameterByName = Element.SetParameterByName(element=sortByKey.sortedList, parameterName=parameter_to_set, value=if_2, lacing=Longest)
name = Element.Name(element=setParameterByName)

# group: Carport Suffix Add
code_block_10 = CodeBlock { "CARPORT"; }
startsWith = String.StartsWith(string=name, searchFor=code_block_10)
filterByBoolMask = List.FilterByBoolMask(list=setParameterByName, mask=startsWith)
filterByBoolMask_2 = List.FilterByBoolMask(list=if_2, mask=startsWith)
suffix = StringInput("C")
add_3 = filterByBoolMask_2.in + suffix
setParameterByName_2 = Element.SetParameterByName(element=filterByBoolMask.in, parameterName=parameter_to_set, value=add_3)

# group: Garage Suffix Add
code_block_11 = CodeBlock { "GARAGE"; }
startsWith_2 = String.StartsWith(string=name, searchFor=code_block_11)
filterByBoolMask_3 = List.FilterByBoolMask(list=setParameterByName, mask=startsWith_2)
filterByBoolMask_4 = List.FilterByBoolMask(list=if_2, mask=startsWith_2)
suffix_2 = StringInput("G")
add_4 = filterByBoolMask_4.in + suffix_2
setParameterByName_3 = Element.SetParameterByName(element=filterByBoolMask_3.in, parameterName=parameter_to_set, value=add_4)
