# Dynamo graph Set_TargetSF.dyn (Dynamo 2.13.1.3887)

# group: GRAB ALL AREAS + SORT BY NAME
categories = Categories("OST_Areas")
all_elements_of_category = ElementsOfCategory(Category=categories)
code_block = CodeBlock { "Name"; }
parameterByName = Parameter.ParameterByName(element=all_elements_of_category, name=code_block)
value = Parameter.Value(parameter=parameterByName)

# group: PHASE I ==>TARGET AREAS + SF + USE + PARKING
code_block_2 = CodeBlock()
# ---------- code_block_2.designscript (12 lines) ----------
"DAYCARE";
"CLASSROOMS";
"SUPERMARKET";
"EVENT SPACE";
"EACS";
"CO-WORK";
"LIBRARY+STUDY";
"MATH+ROBOTICS";
"A1";
"B1";
"C1";
"D1";
# ----------------------------------------
code_block_3 = CodeBlock { 4000; 4800; 6750; 7000; 10000; 15000; 8000; 5000; 550; 780; 1000; 1200; }
code_block_4 = CodeBlock()
# ---------- code_block_4.designscript (12 lines) ----------
"DAY CARE II";
"SPECIALIZED INSTRUCTION SCHOOL";
"RETAIL, GENERAL";
"RECREATIONAL CENTER";
"PROFESSIONAL OFFICE";
"PROFESSIONAL OFFICE";
"LIBRARY";
"LABORATORIES, RESEARCH, DEVELOPMENT AND TESTING";
"1 BED UNIT";
"2 BED UNIT";
"3 BED UNIT";
"4 BED UNIT";
# ----------------------------------------
code_block_5 = CodeBlock()
# ---------- code_block_5.designscript (12 lines) ----------
"2 PER FACILITY + 1 PER EMPLOYEE _ 1 LOAD/UNLOAD PER 10 CHILDREN";
"1 PER EMPLOYEE + 1 PER 2 STUDENTS";
"1 PER 250SF";
"1 PER 400 SF";
"1 PER 300 SF";
"1 PER 300 SF";
"1 PER 200 SF";
"1 PER 300 SF";
"1.5 PER UNIT";
"2 PER UNIT";
"2 PER UNIT";
"2 PER UNIT";
# ----------------------------------------

# group: SETTING ALL APPLICABLE TARGET SF PER AREA NAME
code_block_6 = CodeBlock(a=value, b=code_block_2.out0) { a == b; }
filterByBoolMask = List.FilterByBoolMask(list=all_elements_of_category, mask=code_block_6)
string = StringInput("TargetSF")
setParameterByName = Element.SetParameterByName(element=filterByBoolMask.in, parameterName=string, value=code_block_3.out0)
code_block_7 = CodeBlock(a=value, b=code_block_2.out1) { a == b; }
filterByBoolMask_2 = List.FilterByBoolMask(list=all_elements_of_category, mask=code_block_7)
setParameterByName_2 = Element.SetParameterByName(element=filterByBoolMask_2.in, parameterName=string, value=code_block_3.out1)
code_block_8 = CodeBlock(a=value, b=code_block_2.out2) { a == b; }
filterByBoolMask_3 = List.FilterByBoolMask(list=all_elements_of_category, mask=code_block_8)
setParameterByName_3 = Element.SetParameterByName(element=filterByBoolMask_3.in, parameterName=string, value=code_block_3.out2)
code_block_9 = CodeBlock(a=value, b=code_block_2.out3) { a == b; }
filterByBoolMask_4 = List.FilterByBoolMask(list=all_elements_of_category, mask=code_block_9)
setParameterByName_4 = Element.SetParameterByName(element=filterByBoolMask_4.in, parameterName=string, value=code_block_3.out3)
code_block_10 = CodeBlock(a=value, b=code_block_2.out4) { a == b; }
filterByBoolMask_5 = List.FilterByBoolMask(list=all_elements_of_category, mask=code_block_10)
setParameterByName_5 = Element.SetParameterByName(element=filterByBoolMask_5.in, parameterName=string, value=code_block_3.out4)
code_block_11 = CodeBlock(a=value, b=code_block_2.out5) { a == b; }
filterByBoolMask_6 = List.FilterByBoolMask(list=all_elements_of_category, mask=code_block_11)
setParameterByName_6 = Element.SetParameterByName(element=filterByBoolMask_6.in, parameterName=string, value=code_block_3.out5)
code_block_12 = CodeBlock(a=value, b=code_block_2.out6) { a == b; }
filterByBoolMask_7 = List.FilterByBoolMask(list=all_elements_of_category, mask=code_block_12)
setParameterByName_7 = Element.SetParameterByName(element=filterByBoolMask_7.in, parameterName=string, value=code_block_3.out6)
code_block_13 = CodeBlock(a=value, b=code_block_2.out7) { a == b; }
filterByBoolMask_8 = List.FilterByBoolMask(list=all_elements_of_category, mask=code_block_13)
setParameterByName_8 = Element.SetParameterByName(element=filterByBoolMask_8.in, parameterName=string, value=code_block_3.out7)
code_block_14 = CodeBlock(a=value, b=code_block_2.out8) { a == b; }
filterByBoolMask_9 = List.FilterByBoolMask(list=all_elements_of_category, mask=code_block_14)
setParameterByName_9 = Element.SetParameterByName(element=filterByBoolMask_9.in, parameterName=string, value=code_block_3.out8)
code_block_15 = CodeBlock(a=value, b=code_block_2.out9) { a == b; }
filterByBoolMask_10 = List.FilterByBoolMask(list=all_elements_of_category, mask=code_block_15)
setParameterByName_10 = Element.SetParameterByName(element=filterByBoolMask_10.in, parameterName=string, value=code_block_3.out9)
code_block_16 = CodeBlock(a=value, b=code_block_2.out10) { a == b; }
filterByBoolMask_11 = List.FilterByBoolMask(list=all_elements_of_category, mask=code_block_16)
setParameterByName_11 = Element.SetParameterByName(element=filterByBoolMask_11.in, parameterName=string, value=code_block_3.out10)
code_block_17 = CodeBlock(a=value, b=code_block_2.out11) { a == b; }
filterByBoolMask_12 = List.FilterByBoolMask(list=all_elements_of_category, mask=code_block_17)
setParameterByName_12 = Element.SetParameterByName(element=filterByBoolMask_12.in, parameterName=string, value=code_block_3.out11)

# group: SETTING ALL APPLICABLE TARGET SF PER AREA NAME
code_block_18 = CodeBlock(a=value, b=code_block_2.out0) { a == b; }
filterByBoolMask_13 = List.FilterByBoolMask(list=all_elements_of_category, mask=code_block_18)
string_2 = StringInput("Use")
setParameterByName_13 = Element.SetParameterByName(element=filterByBoolMask_13.in, parameterName=string_2, value=code_block_4.out0)
code_block_19 = CodeBlock(a=value, b=code_block_2.out1) { a == b; }
filterByBoolMask_14 = List.FilterByBoolMask(list=all_elements_of_category, mask=code_block_19)
setParameterByName_14 = Element.SetParameterByName(element=filterByBoolMask_14.in, parameterName=string_2, value=code_block_4.out1)
code_block_20 = CodeBlock(a=value, b=code_block_2.out2) { a == b; }
filterByBoolMask_15 = List.FilterByBoolMask(list=all_elements_of_category, mask=code_block_20)
setParameterByName_15 = Element.SetParameterByName(element=filterByBoolMask_15.in, parameterName=string_2, value=code_block_4.out2)
code_block_21 = CodeBlock(a=value, b=code_block_2.out3) { a == b; }
filterByBoolMask_16 = List.FilterByBoolMask(list=all_elements_of_category, mask=code_block_21)
setParameterByName_16 = Element.SetParameterByName(element=filterByBoolMask_16.in, parameterName=string_2, value=code_block_4.out3)
code_block_22 = CodeBlock(a=value, b=code_block_2.out4) { a == b; }
filterByBoolMask_17 = List.FilterByBoolMask(list=all_elements_of_category, mask=code_block_22)
setParameterByName_17 = Element.SetParameterByName(element=filterByBoolMask_17.in, parameterName=string_2, value=code_block_4.out4)
code_block_23 = CodeBlock(a=value, b=code_block_2.out5) { a == b; }
filterByBoolMask_18 = List.FilterByBoolMask(list=all_elements_of_category, mask=code_block_23)
setParameterByName_18 = Element.SetParameterByName(element=filterByBoolMask_18.in, parameterName=string_2, value=code_block_4.out5)
code_block_24 = CodeBlock(a=value, b=code_block_2.out6) { a == b; }
filterByBoolMask_19 = List.FilterByBoolMask(list=all_elements_of_category, mask=code_block_24)
setParameterByName_19 = Element.SetParameterByName(element=filterByBoolMask_19.in, parameterName=string_2, value=code_block_4.out6)
code_block_25 = CodeBlock(a=value, b=code_block_2.out7) { a == b; }
filterByBoolMask_20 = List.FilterByBoolMask(list=all_elements_of_category, mask=code_block_25)
setParameterByName_20 = Element.SetParameterByName(element=filterByBoolMask_20.in, parameterName=string_2, value=code_block_4.out7)
code_block_26 = CodeBlock(a=value, b=code_block_2.out8) { a == b; }
filterByBoolMask_21 = List.FilterByBoolMask(list=all_elements_of_category, mask=code_block_26)
setParameterByName_21 = Element.SetParameterByName(element=filterByBoolMask_21.in, parameterName=string_2, value=code_block_4.out8)
code_block_27 = CodeBlock(a=value, b=code_block_2.out9) { a == b; }
filterByBoolMask_22 = List.FilterByBoolMask(list=all_elements_of_category, mask=code_block_27)
setParameterByName_22 = Element.SetParameterByName(element=filterByBoolMask_22.in, parameterName=string_2, value=code_block_4.out9)
code_block_28 = CodeBlock(a=value, b=code_block_2.out10) { a == b; }
filterByBoolMask_23 = List.FilterByBoolMask(list=all_elements_of_category, mask=code_block_28)
setParameterByName_23 = Element.SetParameterByName(element=filterByBoolMask_23.in, parameterName=string_2, value=code_block_4.out10)
code_block_29 = CodeBlock(a=value, b=code_block_2.out11) { a == b; }
filterByBoolMask_24 = List.FilterByBoolMask(list=all_elements_of_category, mask=code_block_29)
setParameterByName_24 = Element.SetParameterByName(element=filterByBoolMask_24.in, parameterName=string_2, value=code_block_4.out11)

# group: SETTING ALL APPLICABLE TARGET SF PER AREA NAME
code_block_30 = CodeBlock(a=value, b=code_block_2.out0) { a == b; }
filterByBoolMask_25 = List.FilterByBoolMask(list=all_elements_of_category, mask=code_block_30)
string_3 = StringInput("PARKING REQ")
setParameterByName_25 = Element.SetParameterByName(element=filterByBoolMask_25.in, parameterName=string_3, value=code_block_5.out0)
code_block_31 = CodeBlock(a=value, b=code_block_2.out1) { a == b; }
filterByBoolMask_26 = List.FilterByBoolMask(list=all_elements_of_category, mask=code_block_31)
setParameterByName_26 = Element.SetParameterByName(element=filterByBoolMask_26.in, parameterName=string_3, value=code_block_5.out1)
code_block_32 = CodeBlock(a=value, b=code_block_2.out2) { a == b; }
filterByBoolMask_27 = List.FilterByBoolMask(list=all_elements_of_category, mask=code_block_32)
setParameterByName_27 = Element.SetParameterByName(element=filterByBoolMask_27.in, parameterName=string_3, value=code_block_5.out2)
code_block_33 = CodeBlock(a=value, b=code_block_2.out3) { a == b; }
filterByBoolMask_28 = List.FilterByBoolMask(list=all_elements_of_category, mask=code_block_33)
setParameterByName_28 = Element.SetParameterByName(element=filterByBoolMask_28.in, parameterName=string_3, value=code_block_5.out3)
code_block_34 = CodeBlock(a=value, b=code_block_2.out4) { a == b; }
filterByBoolMask_29 = List.FilterByBoolMask(list=all_elements_of_category, mask=code_block_34)
setParameterByName_29 = Element.SetParameterByName(element=filterByBoolMask_29.in, parameterName=string_3, value=code_block_5.out4)
code_block_35 = CodeBlock(a=value, b=code_block_2.out5) { a == b; }
filterByBoolMask_30 = List.FilterByBoolMask(list=all_elements_of_category, mask=code_block_35)
setParameterByName_30 = Element.SetParameterByName(element=filterByBoolMask_30.in, parameterName=string_3, value=code_block_5.out5)
code_block_36 = CodeBlock(a=value, b=code_block_2.out6) { a == b; }
filterByBoolMask_31 = List.FilterByBoolMask(list=all_elements_of_category, mask=code_block_36)
setParameterByName_31 = Element.SetParameterByName(element=filterByBoolMask_31.in, parameterName=string_3, value=code_block_5.out6)
code_block_37 = CodeBlock(a=value, b=code_block_2.out7) { a == b; }
filterByBoolMask_32 = List.FilterByBoolMask(list=all_elements_of_category, mask=code_block_37)
setParameterByName_32 = Element.SetParameterByName(element=filterByBoolMask_32.in, parameterName=string_3, value=code_block_5.out7)
code_block_38 = CodeBlock(a=value, b=code_block_2.out8) { a == b; }
filterByBoolMask_33 = List.FilterByBoolMask(list=all_elements_of_category, mask=code_block_38)
setParameterByName_33 = Element.SetParameterByName(element=filterByBoolMask_33.in, parameterName=string_3, value=code_block_5.out8)
code_block_39 = CodeBlock(a=value, b=code_block_2.out9) { a == b; }
filterByBoolMask_34 = List.FilterByBoolMask(list=all_elements_of_category, mask=code_block_39)
setParameterByName_34 = Element.SetParameterByName(element=filterByBoolMask_34.in, parameterName=string_3, value=code_block_5.out9)
code_block_40 = CodeBlock(a=value, b=code_block_2.out10) { a == b; }
filterByBoolMask_35 = List.FilterByBoolMask(list=all_elements_of_category, mask=code_block_40)
setParameterByName_35 = Element.SetParameterByName(element=filterByBoolMask_35.in, parameterName=string_3, value=code_block_5.out10)
code_block_41 = CodeBlock(a=value, b=code_block_2.out11) { a == b; }
filterByBoolMask_36 = List.FilterByBoolMask(list=all_elements_of_category, mask=code_block_41)
setParameterByName_36 = Element.SetParameterByName(element=filterByBoolMask_36.in, parameterName=string_3, value=code_block_5.out11)

# group: PHASE II ==>TARGET AREAS + SF + USE + PARKING
code_block_42 = CodeBlock()
# ---------- code_block_42.designscript (19 lines) ----------
"RESTAURANTS";
"COFFEE/CAFE";
"COMMON SEATING";
"OFFICES (S)";
"OFFICES (M)";
"OFFICES (L)";
"CONFERENCE";
"PRAYER (L)";
"SHOPS (S)";
"SHOPS (M)";
"SHOPS (L)";
"RETAIL (S)";
"RETAIL (L)";
"PRAYER (S)";
"SPA";
"MAKE-UP STUDIOS";
"BARBER SHOPS";
"MASSAGE STUDIOS";
"RETAIL (M)";
# ----------------------------------------
code_block_43 = CodeBlock { 3000; 3500; 1500; 3600; 2100; 800; 600; 900; 4200; 3000; 800; 4400; 3000; 600; 1000; 3000; 1000; 900; 2100; }
code_block_44 = CodeBlock()
# ---------- code_block_44.designscript (19 lines) ----------
"RESTAURANT";
"COFFEE SHOP/ RETAIN FOOD SHOP";
" ";
"PROFESSIONAL OFFICE";
"PROFESSIONAL OFFICE";
"PROFESSIONAL OFFICE";
"ASSEMBLY/CONVENTION";
"RELIGIOUS USE FACILITY";
"RETAIL, GENERAL";
"RETAIL, GENERAL";
"RETAIL, GENERAL";
"RETAIL, GENERAL";
"RETAIL, GENERAL";
"RELIGIOUS USE FACILITY";
"BEAUTY SALON/ PERSONAL GROOMING SERVICE";
"BEAUTY SALON/ PERSONAL GROOMING SERVICE";
"BEAUTY SALON/ PERSONAL GROOMING SERVICE";
"BEAUTY SALON/ PERSONAL GROOMING SERVICE";
"RETAIL, GENERAL";
# ----------------------------------------
code_block_45 = CodeBlock()
# ---------- code_block_45.designscript (19 lines) ----------
"1 PER 150 LEASABLE SPACE";
"1 PER 250 SF OF LEASABLE SPACE";
" ";
"1 PER 300 SF";
"1 PER 300 SF";
"1 PER 300 SF";
"1 PER 40 SF W/O FIXED SEATS";
"1 PER 4 FIXED SEATS OR 1 PER 40 SF W/0 FIXED SEATS";
"1 PER 250 SF";
"1 PER 250 SF";
"1 PER 250 SF";
"1 PER 250 SF";
"1 PER 250 SF";
"1 PER 4 FIXED SEATS OR 1 PER 40 SF W/0 FIXED SEATS";
"1 PER 200 GSF";
"1 PER 200 GSF";
"1 PER 200 GSF";
"1 PER 200 GSF";
"1 PER 250 SF";
# ----------------------------------------

# group: SETTING ALL APPLICABLE TARGET SF PER AREA NAME
code_block_46 = CodeBlock(a=value, b=code_block_42.out0) { a == b; }
filterByBoolMask_37 = List.FilterByBoolMask(list=all_elements_of_category, mask=code_block_46)
string_4 = StringInput("TargetSF")
setParameterByName_37 = Element.SetParameterByName(element=filterByBoolMask_37.in, parameterName=string_4, value=code_block_43.out0)
code_block_47 = CodeBlock(a=value, b=code_block_42.out1) { a == b; }
filterByBoolMask_38 = List.FilterByBoolMask(list=all_elements_of_category, mask=code_block_47)
setParameterByName_38 = Element.SetParameterByName(element=filterByBoolMask_38.in, parameterName=string_4, value=code_block_43.out1)
code_block_48 = CodeBlock(a=value, b=code_block_42.out2) { a == b; }
filterByBoolMask_39 = List.FilterByBoolMask(list=all_elements_of_category, mask=code_block_48)
setParameterByName_39 = Element.SetParameterByName(element=filterByBoolMask_39.in, parameterName=string_4, value=code_block_43.out2)
code_block_49 = CodeBlock(a=value, b=code_block_42.out3) { a == b; }
filterByBoolMask_40 = List.FilterByBoolMask(list=all_elements_of_category, mask=code_block_49)
setParameterByName_40 = Element.SetParameterByName(element=filterByBoolMask_40.in, parameterName=string_4, value=code_block_43.out3)
code_block_50 = CodeBlock(a=value, b=code_block_42.out4) { a == b; }
filterByBoolMask_41 = List.FilterByBoolMask(list=all_elements_of_category, mask=code_block_50)
setParameterByName_41 = Element.SetParameterByName(element=filterByBoolMask_41.in, parameterName=string_4, value=code_block_43.out4)
code_block_51 = CodeBlock(a=value, b=code_block_42.out5) { a == b; }
filterByBoolMask_42 = List.FilterByBoolMask(list=all_elements_of_category, mask=code_block_51)
setParameterByName_42 = Element.SetParameterByName(element=filterByBoolMask_42.in, parameterName=string_4, value=code_block_43.out5)
code_block_52 = CodeBlock(a=value, b=code_block_42.out6) { a == b; }
filterByBoolMask_43 = List.FilterByBoolMask(list=all_elements_of_category, mask=code_block_52)
setParameterByName_43 = Element.SetParameterByName(element=filterByBoolMask_43.in, parameterName=string_4, value=code_block_43.out6)
code_block_53 = CodeBlock(a=value, b=code_block_42.out7) { a == b; }
filterByBoolMask_44 = List.FilterByBoolMask(list=all_elements_of_category, mask=code_block_53)
setParameterByName_44 = Element.SetParameterByName(element=filterByBoolMask_44.in, parameterName=string_4, value=code_block_43.out7)
code_block_54 = CodeBlock(a=value, b=code_block_42.out8) { a == b; }
filterByBoolMask_45 = List.FilterByBoolMask(list=all_elements_of_category, mask=code_block_54)
setParameterByName_45 = Element.SetParameterByName(element=filterByBoolMask_45.in, parameterName=string_4, value=code_block_43.out8)
code_block_55 = CodeBlock(a=value, b=code_block_42.out9) { a == b; }
filterByBoolMask_46 = List.FilterByBoolMask(list=all_elements_of_category, mask=code_block_55)
setParameterByName_46 = Element.SetParameterByName(element=filterByBoolMask_46.in, parameterName=string_4, value=code_block_43.out9)
code_block_56 = CodeBlock(a=value, b=code_block_42.out10) { a == b; }
filterByBoolMask_47 = List.FilterByBoolMask(list=all_elements_of_category, mask=code_block_56)
setParameterByName_47 = Element.SetParameterByName(element=filterByBoolMask_47.in, parameterName=string_4, value=code_block_43.out10)
code_block_57 = CodeBlock(a=value, b=code_block_42.out11) { a == b; }
filterByBoolMask_48 = List.FilterByBoolMask(list=all_elements_of_category, mask=code_block_57)
setParameterByName_48 = Element.SetParameterByName(element=filterByBoolMask_48.in, parameterName=string_4, value=code_block_43.out11)
code_block_58 = CodeBlock(a=value, b=code_block_42.out12) { a == b; }
filterByBoolMask_49 = List.FilterByBoolMask(list=all_elements_of_category, mask=code_block_58)
setParameterByName_49 = Element.SetParameterByName(element=filterByBoolMask_49.in, parameterName=string_4, value=code_block_43.out12)
code_block_59 = CodeBlock(a=value, b=code_block_42.out13) { a == b; }
filterByBoolMask_50 = List.FilterByBoolMask(list=all_elements_of_category, mask=code_block_59)
setParameterByName_50 = Element.SetParameterByName(element=filterByBoolMask_50.in, parameterName=string_4, value=code_block_43.out13)
code_block_60 = CodeBlock(a=value, b=code_block_42.out14) { a == b; }
filterByBoolMask_51 = List.FilterByBoolMask(list=all_elements_of_category, mask=code_block_60)
setParameterByName_51 = Element.SetParameterByName(element=filterByBoolMask_51.in, parameterName=string_4, value=code_block_43.out14)
code_block_61 = CodeBlock(a=value, b=code_block_42.out15) { a == b; }
filterByBoolMask_52 = List.FilterByBoolMask(list=all_elements_of_category, mask=code_block_61)
setParameterByName_52 = Element.SetParameterByName(element=filterByBoolMask_52.in, parameterName=string_4, value=code_block_43.out15)
code_block_62 = CodeBlock(a=value, b=code_block_42.out16) { a == b; }
filterByBoolMask_53 = List.FilterByBoolMask(list=all_elements_of_category, mask=code_block_62)
setParameterByName_53 = Element.SetParameterByName(element=filterByBoolMask_53.in, parameterName=string_4, value=code_block_43.out16)
code_block_63 = CodeBlock(a=value, b=code_block_42.out17) { a == b; }
filterByBoolMask_54 = List.FilterByBoolMask(list=all_elements_of_category, mask=code_block_63)
setParameterByName_54 = Element.SetParameterByName(element=filterByBoolMask_54.in, parameterName=string_4, value=code_block_43.out17)
code_block_64 = CodeBlock(a=value, b=code_block_42.out18) { a == b; }
filterByBoolMask_55 = List.FilterByBoolMask(list=all_elements_of_category, mask=code_block_64)
setParameterByName_55 = Element.SetParameterByName(element=filterByBoolMask_55.in, parameterName=string_4, value=code_block_43.out18)

# group: SETTING ALL APPLICABLE TARGET SF PER AREA NAME
code_block_65 = CodeBlock(a=value, b=code_block_42.out0) { a == b; }
filterByBoolMask_56 = List.FilterByBoolMask(list=all_elements_of_category, mask=code_block_65)
string_5 = StringInput("Use")
setParameterByName_56 = Element.SetParameterByName(element=filterByBoolMask_56.in, parameterName=string_5, value=code_block_44.out0)
code_block_66 = CodeBlock(a=value, b=code_block_42.out1) { a == b; }
filterByBoolMask_57 = List.FilterByBoolMask(list=all_elements_of_category, mask=code_block_66)
setParameterByName_57 = Element.SetParameterByName(element=filterByBoolMask_57.in, parameterName=string_5, value=code_block_44.out1)
code_block_67 = CodeBlock(a=value, b=code_block_42.out2) { a == b; }
filterByBoolMask_58 = List.FilterByBoolMask(list=all_elements_of_category, mask=code_block_67)
setParameterByName_58 = Element.SetParameterByName(element=filterByBoolMask_58.in, parameterName=string_5, value=code_block_44.out2)
code_block_68 = CodeBlock(a=value, b=code_block_42.out3) { a == b; }
filterByBoolMask_59 = List.FilterByBoolMask(list=all_elements_of_category, mask=code_block_68)
setParameterByName_59 = Element.SetParameterByName(element=filterByBoolMask_59.in, parameterName=string_5, value=code_block_44.out3)
code_block_69 = CodeBlock(a=value, b=code_block_42.out4) { a == b; }
filterByBoolMask_60 = List.FilterByBoolMask(list=all_elements_of_category, mask=code_block_69)
setParameterByName_60 = Element.SetParameterByName(element=filterByBoolMask_60.in, parameterName=string_5, value=code_block_44.out4)
code_block_70 = CodeBlock(a=value, b=code_block_42.out5) { a == b; }
filterByBoolMask_61 = List.FilterByBoolMask(list=all_elements_of_category, mask=code_block_70)
setParameterByName_61 = Element.SetParameterByName(element=filterByBoolMask_61.in, parameterName=string_5, value=code_block_44.out5)
code_block_71 = CodeBlock(a=value, b=code_block_42.out6) { a == b; }
filterByBoolMask_62 = List.FilterByBoolMask(list=all_elements_of_category, mask=code_block_71)
setParameterByName_62 = Element.SetParameterByName(element=filterByBoolMask_62.in, parameterName=string_5, value=code_block_44.out6)
code_block_72 = CodeBlock(a=value, b=code_block_42.out7) { a == b; }
filterByBoolMask_63 = List.FilterByBoolMask(list=all_elements_of_category, mask=code_block_72)
setParameterByName_63 = Element.SetParameterByName(element=filterByBoolMask_63.in, parameterName=string_5, value=code_block_44.out7)
code_block_73 = CodeBlock(a=value, b=code_block_42.out8) { a == b; }
filterByBoolMask_64 = List.FilterByBoolMask(list=all_elements_of_category, mask=code_block_73)
setParameterByName_64 = Element.SetParameterByName(element=filterByBoolMask_64.in, parameterName=string_5, value=code_block_44.out8)
code_block_74 = CodeBlock(a=value, b=code_block_42.out9) { a == b; }
filterByBoolMask_65 = List.FilterByBoolMask(list=all_elements_of_category, mask=code_block_74)
setParameterByName_65 = Element.SetParameterByName(element=filterByBoolMask_65.in, parameterName=string_5, value=code_block_44.out9)
code_block_75 = CodeBlock(a=value, b=code_block_42.out10) { a == b; }
filterByBoolMask_66 = List.FilterByBoolMask(list=all_elements_of_category, mask=code_block_75)
setParameterByName_66 = Element.SetParameterByName(element=filterByBoolMask_66.in, parameterName=string_5, value=code_block_44.out10)
code_block_76 = CodeBlock(a=value, b=code_block_42.out11) { a == b; }
filterByBoolMask_67 = List.FilterByBoolMask(list=all_elements_of_category, mask=code_block_76)
setParameterByName_67 = Element.SetParameterByName(element=filterByBoolMask_67.in, parameterName=string_5, value=code_block_44.out11)
code_block_77 = CodeBlock(a=value, b=code_block_42.out12) { a == b; }
filterByBoolMask_68 = List.FilterByBoolMask(list=all_elements_of_category, mask=code_block_77)
setParameterByName_68 = Element.SetParameterByName(element=filterByBoolMask_68.in, parameterName=string_5, value=code_block_44.out12)
code_block_78 = CodeBlock(a=value, b=code_block_42.out15) { a == b; }
filterByBoolMask_69 = List.FilterByBoolMask(list=all_elements_of_category, mask=code_block_78)
setParameterByName_69 = Element.SetParameterByName(element=filterByBoolMask_69.in, parameterName=string_5, value=code_block_44.out15)
code_block_79 = CodeBlock(a=value, b=code_block_42.out16) { a == b; }
filterByBoolMask_70 = List.FilterByBoolMask(list=all_elements_of_category, mask=code_block_79)
setParameterByName_70 = Element.SetParameterByName(element=filterByBoolMask_70.in, parameterName=string_5, value=code_block_44.out16)
code_block_80 = CodeBlock(a=value, b=code_block_42.out13) { a == b; }
filterByBoolMask_71 = List.FilterByBoolMask(list=all_elements_of_category, mask=code_block_80)
setParameterByName_71 = Element.SetParameterByName(element=filterByBoolMask_71.in, parameterName=string_5, value=code_block_44.out13)
code_block_81 = CodeBlock(a=value, b=code_block_42.out14) { a == b; }
filterByBoolMask_72 = List.FilterByBoolMask(list=all_elements_of_category, mask=code_block_81)
setParameterByName_72 = Element.SetParameterByName(element=filterByBoolMask_72.in, parameterName=string_5, value=code_block_44.out14)
code_block_82 = CodeBlock(a=value, b=code_block_42.out17) { a == b; }
filterByBoolMask_73 = List.FilterByBoolMask(list=all_elements_of_category, mask=code_block_82)
setParameterByName_73 = Element.SetParameterByName(element=filterByBoolMask_73.in, parameterName=string_5, value=code_block_44.out17)
code_block_83 = CodeBlock(a=value, b=code_block_42.out18) { a == b; }
filterByBoolMask_74 = List.FilterByBoolMask(list=all_elements_of_category, mask=code_block_83)
setParameterByName_74 = Element.SetParameterByName(element=filterByBoolMask_74.in, parameterName=string_5, value=code_block_44.out18)

# group: SETTING ALL APPLICABLE TARGET SF PER AREA NAME
code_block_84 = CodeBlock(a=value, b=code_block_42.out0) { a == b; }
filterByBoolMask_75 = List.FilterByBoolMask(list=all_elements_of_category, mask=code_block_84)
string_6 = StringInput("Use")
setParameterByName_75 = Element.SetParameterByName(element=filterByBoolMask_75.in, parameterName=string_6, value=code_block_45.out0)
code_block_85 = CodeBlock(a=value, b=code_block_42.out1) { a == b; }
filterByBoolMask_76 = List.FilterByBoolMask(list=all_elements_of_category, mask=code_block_85)
setParameterByName_76 = Element.SetParameterByName(element=filterByBoolMask_76.in, parameterName=string_6, value=code_block_45.out1)
code_block_86 = CodeBlock(a=value, b=code_block_42.out2) { a == b; }
filterByBoolMask_77 = List.FilterByBoolMask(list=all_elements_of_category, mask=code_block_86)
setParameterByName_77 = Element.SetParameterByName(element=filterByBoolMask_77.in, parameterName=string_6, value=code_block_45.out2)
code_block_87 = CodeBlock(a=value, b=code_block_42.out3) { a == b; }
filterByBoolMask_78 = List.FilterByBoolMask(list=all_elements_of_category, mask=code_block_87)
setParameterByName_78 = Element.SetParameterByName(element=filterByBoolMask_78.in, parameterName=string_6, value=code_block_45.out3)
code_block_88 = CodeBlock(a=value, b=code_block_42.out4) { a == b; }
filterByBoolMask_79 = List.FilterByBoolMask(list=all_elements_of_category, mask=code_block_88)
setParameterByName_79 = Element.SetParameterByName(element=filterByBoolMask_79.in, parameterName=string_6, value=code_block_45.out4)
code_block_89 = CodeBlock(a=value, b=code_block_42.out5) { a == b; }
filterByBoolMask_80 = List.FilterByBoolMask(list=all_elements_of_category, mask=code_block_89)
setParameterByName_80 = Element.SetParameterByName(element=filterByBoolMask_80.in, parameterName=string_6, value=code_block_45.out5)
code_block_90 = CodeBlock(a=value, b=code_block_42.out6) { a == b; }
filterByBoolMask_81 = List.FilterByBoolMask(list=all_elements_of_category, mask=code_block_90)
setParameterByName_81 = Element.SetParameterByName(element=filterByBoolMask_81.in, parameterName=string_6, value=code_block_45.out6)
code_block_91 = CodeBlock(a=value, b=code_block_42.out7) { a == b; }
filterByBoolMask_82 = List.FilterByBoolMask(list=all_elements_of_category, mask=code_block_91)
setParameterByName_82 = Element.SetParameterByName(element=filterByBoolMask_82.in, parameterName=string_6, value=code_block_45.out7)
code_block_92 = CodeBlock(a=value, b=code_block_42.out8) { a == b; }
filterByBoolMask_83 = List.FilterByBoolMask(list=all_elements_of_category, mask=code_block_92)
setParameterByName_83 = Element.SetParameterByName(element=filterByBoolMask_83.in, parameterName=string_6, value=code_block_45.out8)
code_block_93 = CodeBlock(a=value, b=code_block_42.out9) { a == b; }
filterByBoolMask_84 = List.FilterByBoolMask(list=all_elements_of_category, mask=code_block_93)
setParameterByName_84 = Element.SetParameterByName(element=filterByBoolMask_84.in, parameterName=string_6, value=code_block_45.out9)
code_block_94 = CodeBlock(a=value, b=code_block_42.out10) { a == b; }
filterByBoolMask_85 = List.FilterByBoolMask(list=all_elements_of_category, mask=code_block_94)
setParameterByName_85 = Element.SetParameterByName(element=filterByBoolMask_85.in, parameterName=string_6, value=code_block_45.out10)
code_block_95 = CodeBlock(a=value, b=code_block_42.out11) { a == b; }
filterByBoolMask_86 = List.FilterByBoolMask(list=all_elements_of_category, mask=code_block_95)
setParameterByName_86 = Element.SetParameterByName(element=filterByBoolMask_86.in, parameterName=string_6, value=code_block_45.out11)
code_block_96 = CodeBlock(a=value, b=code_block_42.out12) { a == b; }
filterByBoolMask_87 = List.FilterByBoolMask(list=all_elements_of_category, mask=code_block_96)
setParameterByName_87 = Element.SetParameterByName(element=filterByBoolMask_87.in, parameterName=string_6, value=code_block_45.out12)
code_block_97 = CodeBlock(a=value, b=code_block_42.out15) { a == b; }
filterByBoolMask_88 = List.FilterByBoolMask(list=all_elements_of_category, mask=code_block_97)
setParameterByName_88 = Element.SetParameterByName(element=filterByBoolMask_88.in, parameterName=string_6, value=code_block_45.out15)
code_block_98 = CodeBlock(a=value, b=code_block_42.out16) { a == b; }
filterByBoolMask_89 = List.FilterByBoolMask(list=all_elements_of_category, mask=code_block_98)
setParameterByName_89 = Element.SetParameterByName(element=filterByBoolMask_89.in, parameterName=string_6, value=code_block_45.out16)
code_block_99 = CodeBlock(a=value, b=code_block_42.out13) { a == b; }
filterByBoolMask_90 = List.FilterByBoolMask(list=all_elements_of_category, mask=code_block_99)
setParameterByName_90 = Element.SetParameterByName(element=filterByBoolMask_90.in, parameterName=string_6, value=code_block_45.out13)
code_block_100 = CodeBlock(a=value, b=code_block_42.out14) { a == b; }
filterByBoolMask_91 = List.FilterByBoolMask(list=all_elements_of_category, mask=code_block_100)
setParameterByName_91 = Element.SetParameterByName(element=filterByBoolMask_91.in, parameterName=string_6, value=code_block_45.out14)
code_block_101 = CodeBlock(a=value, b=code_block_42.out17) { a == b; }
filterByBoolMask_92 = List.FilterByBoolMask(list=all_elements_of_category, mask=code_block_101)
setParameterByName_92 = Element.SetParameterByName(element=filterByBoolMask_92.in, parameterName=string_6, value=code_block_45.out17)
code_block_102 = CodeBlock(a=value, b=code_block_42.out18) { a == b; }
filterByBoolMask_93 = List.FilterByBoolMask(list=all_elements_of_category, mask=code_block_102)
setParameterByName_93 = Element.SetParameterByName(element=filterByBoolMask_93.in, parameterName=string_6, value=code_block_45.out18)
